vi "Main.gviweb"   [LabVIEW NXG 3.1.0]
panel controls:
  "Send Log": bool
  "Stop Test": bool
  "Start Test": bool
  "System": i32
panel indicators:
  "Files Sent": f64
  "Buffer": f64
  "Temperature History": f64[][]
  "Testing": bool
  "System Status": string
  "Memory Percentage Used": f64
  "Disk Percentage Used": f64
  "Temperature Current Values": f64[]
  "Application Status": string
  "Last Updated": timestamp
uses:
  NI::Skyline::Configuration::Open Configuration.gvi
  Application::Filter Systems by Package.gviweb
  Application::Get System Info.gviweb
  NI::Skyline::TagHTTP::Multi Read.gvi
  NI::Skyline::TagHTTP::Configure Tag History Window (Count).gvi
  NI::Skyline::TagHTTP::Multi Read History.gvi
  NI::Skyline::MessageHTTP::Open.gvi
  NI::Skyline::MessageHTTP::Publish.gvi
  NI::Skyline::MessageHTTP::Close.gvi
diagram:
  w1 = ""  # Server
  call "Open Configuration.gvi"(server url=w1, username="", password="") -> (configuration=w2, error out=w3)
  call "Filter Systems by Package.gviweb"(configuration in=w2, package="crio-test-cell", error in=w3) -> (configuration out=w4, systems=w5, error out=w6)
  for {
    w7 = each element of w5
    Property Node(instance in=w7) -> ("alias"=w9)
    append w9 to w8
  }
  Property Node(instance in=reference to "System", "Items"=w8, "Value"=0, error in=w6) -> (error out=w10)
  while {
    Property Node(instance in=reference to "System", error in=w10) -> ("Items"=w11)
    Array Index(array=w11) -> (out0[$System]=w12)
    call "Get System Info.gviweb"(configuration in=w4, System=w12) -> (State=w13, configuration out=w14, ID=w15)
    event (timeout = 500) {
      on Timeout {
        case (w13) {
          frame "Disconnected", Default {
            Property Node(instance in=reference to "Testing", "Value"=FALSE)
            w16 = TRUE
          }
          frame "Connected" {
            Get Current Time() -> (current time=w17)
            call "Read AI.gviweb"(configuration=w14, minion id=w15) -> (tags=w18, number of tags=w19)
            Time Stamp Subtract(x=w17, y=1000) -> w20
            case (w19) {
              frame 0 {
                w21 = f64[][] []
                w22 = f64[] []
              }
              frame 1, Default {
                call "Multi Read.gvi"(tags in=w18) -> (tag clusters=w23)
                call "Configure Tag History Window (Count).gvi"(start=w20, end=w17, newest first?=FALSE) -> (history window=w24)
                call "Multi Read History.gvi"(tags in=w18, tag history window=w24) -> (values=w25)
                for {
                  w26 = each element of w25
                  w27 = each element of w23
                  Property Node(instance in=w26) -> ("Values"=w28)
                  for {
                    w29 = each element of w28
                    Scan Value(format string="%f", string=w29) -> (value=w31)
                    append w31 to w30
                  }
                  Property Node(instance in=w27) -> ("Value"=w32)
                  Scan Value(format string="%f", string=w32) -> (value=w33)
                  append w30 to w21
                  append w33 to w22
                }
              }
            }
            $"Temperature History" <- w21
            $"Temperature Current Values" <- w22
            call "Read Health.gviweb"(configuration=w14, minion id=w15) -> (tags=w34)
            for {
              w35 = each element of w34
              Property Node(instance in=w35) -> ("Path"=w36, "Value"=w37, "Time Stamp"=w38)
              Search Or Split String(search string/char=".", string=w36) -> (match + rest of string=w39)
              case (w39) {
                frame ".Health.Disk.UsePercentage" {
                  Scan Value(format string="%f", string=w37) -> (value=w40)
                  $"Disk Percentage Used" <- w40
                }
                frame ".Health.Memory.UsePercentage" {
                  Scan Value(format string="%f", string=w37) -> (value=w41)
                  $"Memory Percentage Used" <- w41
                }
                frame ".cRIO_Test_Cell.files_sent" {
                  Scan Value(format string="%d", string=w37) -> (value=w42)
                  $"Files Sent" <- w42
                }
                frame ".cRIO_Test_Cell.buffer" {
                  Scan Value(format string="%d", string=w37) -> (value=w43)
                  $Buffer <- w43
                }
                frame ".cRIO_Test_Cell.testing" {
                  case (w37) {
                    frame "False", Default {
                      w44 = FALSE
                    }
                    frame "True" {
                      w44 = TRUE
                    }
                  }
                  $Testing <- w44
                }
                frame ".cRIO_Test_Cell.status" {
                  $"Application Status" <- w37
                  $"Last Updated" <- w38
                }
                frame Default { }
              }
            }
            w16 = FALSE
          }
        }
        Property Node(instance in=reference to "Stop Test", "Disabled"=w16)
        Property Node(instance in=reference to "Start Test", "Disabled"=w16)
        Property Node(instance in=reference to "Send Log", "Disabled"=w16)
      }
      on "Send Log" Value changed {
        call "Open.gvi"(configuration=w14) -> (message session out=w45, error out=w46)
        call "Publish.gvi"(message session=w45, topic=w15, message="Send File", error in=w46) -> (message session out=w47, error out=w48)
        call "Close.gvi"(message session=w47, error in=w48)
      }
      on "Start Test" Value changed {
        call "Open.gvi"(configuration=w14) -> (message session out=w49, error out=w50)
        call "Publish.gvi"(message session=w49, topic=w15, message="Start Test", error in=w50) -> (message session out=w51, error out=w52)
        call "Close.gvi"(message session=w51, error in=w52)
      }
      on "Stop Test" Value changed {
        call "Open.gvi"(configuration=w14) -> (message session out=w53, error out=w54)
        call "Publish.gvi"(message session=w53, topic=w15, message="Stop Test", error in=w54) -> (message session out=w55, error out=w56)
        call "Close.gvi"(message session=w55, error in=w56)
      }
      on "System" Value changed {
        Property Node(instance in=reference to "Testing", "Value"=FALSE)
        Property Node(instance in=reference to "Last Updated", "Value"=1904-01-01T00:00:00Z)
        Property Node(instance in=reference to "Files Sent", "Value"=0)
        Property Node(instance in=reference to "Buffer", "Value"=0)
        Property Node(instance in=reference to "Application Status", "Value"="")
      }
    }
    $"System Status" <- w13
    stop if FALSE
  }
